# Dynamo graph ENECA-КР-Сбор информации-D1.0-v1.0.dyn (Dynamo 2.6.1.8786)

file_path = Filename(".\ENECA-КР-Сбор информации-D1.0-v1.0.py")
file_from_path = FileObject(path=file_path)
readText = FileSystem.ReadText(file=file_from_path)
выбор_типа_аннотаций_вручную = BoolSelector(false)
python_script_from_string = PythonStringNode(script=readText, IN[0]=выбор_типа_аннотаций_вручную)
watch = Watch(python_script_from_string)
string = StringInput("C:\Users\User\Desktop\revit_data2.csv")
exportCSV = Data.ExportCSV(filePath=string, data=python_script_from_string)
